# Grasshopper definition Utilities_Collection of working c# codes.gh (Grasshopper 1.0.7)

# ----
# A LIST OF C# CODE THAT WORKS
# filter data type of a list
c_script = CSharpScript()  # -> out, A; inputs x: list
# ---------- c_script: C# usings ----------
using System.Linq;
# ---------- c_script: C# ----------
    //List <double> output = new List<double>{};

    A = getRadius(x);

    //A = output;
# ---------- c_script: C# additional code ----------
  public List<double> getRadius(List<object> item)
  {
    return item.OfType<double>().ToList();
  }
# ---------- end c_script ----------
